# Grasshopper definition clip1.gh (Grasshopper 1.0.7)

# ----
# layer 1
rectangle = Rectangle(Plane=PlaneXY(0, 0, 0), XSize=Slider(0.2, range=0..10), YSize=Slider(4, range=0..20), Radius=0)  # -> Rectangle, Length
vector_xyz = VectorXYZ(XComponent=0, YComponent=0, ZComponent=Slider(6, range=0..20))  # -> Vector, Length
extrude = Extrude(Base=rectangle.Rectangle, Direction=vector_xyz.Vector)
cap_holes = CapHoles(Brep=extrude)

rectangle_2 = Rectangle(Plane=PlaneXY(0, 0, 0), XSize=Slider(0.4, range=0..10), YSize=Slider(3, range=0..20), Radius=0)  # -> Rectangle, Length
# Middle rectangle
vector_xyz_2 = VectorXYZ(XComponent=Slider(0.2, range=-1.001..5), YComponent=Slider(0.435, range=0..1), ZComponent=Slider(2.5, range=0..5))  # -> Vector, Length
move = Move(Geometry=rectangle_2.Rectangle, Motion=vector_xyz_2.Vector)  # -> Geometry, Transform
vector_xyz_3 = VectorXYZ(XComponent=0, YComponent=0, ZComponent=Slider(1, range=0..20))  # -> Vector, Length
extrude_2 = Extrude(Base=move.Geometry, Direction=vector_xyz_3.Vector)
cap_holes_2 = CapHoles(Brep=extrude_2)

# ----
# duplicate & move layer
unit_x = UnitX(Factor=Slider(0.55, range=0..1))
move_2 = Move(Geometry=cap_holes, Motion=unit_x)  # -> Geometry, Transform
