# Grasshopper definition clip2.gh (Grasshopper 1.0.7)

# ----
# Layer 1
rectangle = Rectangle(Plane=PlaneXY(0, 0, 0), XSize=Slider(0.15, range=0..5), YSize=Slider(2, range=0..10), Radius=0)  # -> Rectangle, Length
unit_z = UnitZ(Factor=Slider(4.5, range=0..10))
extrude = Extrude(Base=rectangle.Rectangle, Direction=unit_z)
cap_holes = CapHoles(Brep=extrude)

# ----
# Layer 2
rectangle_2 = Rectangle(Plane=PlaneXY(0, 0, 0), XSize=Slider(0.15, range=0..10), YSize=Slider(2, range=0..10), Radius=0)  # -> Rectangle, Length
unit_z_2 = UnitZ(Factor=Slider(4.5, range=0..10))
# Middle block
number_slider = Slider(0.35, range=0..10)
extrude_2 = Extrude(Base=rectangle_2.Rectangle, Direction=unit_z_2)
cap_holes_2 = CapHoles(Brep=extrude_2)
vector_xyz = VectorXYZ(XComponent=number_slider, YComponent=0, ZComponent=0)  # -> Vector, Length
move = Move(Geometry=cap_holes_2, Motion=vector_xyz.Vector)  # -> Geometry, Transform

rectangle_3 = Rectangle(Plane=PlaneXY(0, 0, 0), XSize=Slider(0.2, range=0..10), YSize=Slider(2, range=0..10), Radius=0)  # -> Rectangle, Length
unit_z_3 = UnitZ(Factor=Slider(0.15, range=0..10))
extrude_3 = Extrude(Base=rectangle_3.Rectangle, Direction=unit_z_3)
cap_holes_3 = CapHoles(Brep=extrude_3)
vector_xyz_2 = VectorXYZ(XComponent=Slider(0.15, range=0..10), YComponent=0, ZComponent=Slider(2.2, range=0..10))  # -> Vector, Length
move_2 = Move(Geometry=cap_holes_3, Motion=vector_xyz_2.Vector)  # -> Geometry, Transform

solid_intersection = SolidIntersection(BrepsA=move.Geometry, BrepsB=move_2.Geometry)
solid_intersection_2 = SolidIntersection(BrepsA=cap_holes, BrepsB=move_2.Geometry)
