# Grasshopper definition lofts.gh (Grasshopper 1.0.7)

polygon = Polygon(Plane=PlaneXY(0, 0, 0), Radius=Slider(5, range=3..11), Segments=Slider(6, range=3..11), FilletRadius=0)  # -> Polygon, Length
polygon_2 = Polygon(Plane=PlaneXY(0, 0, 0), Radius=Slider(9, range=3..11), Segments=Slider(8, range=3..11), FilletRadius=0)  # -> Polygon, Length
move = Move(Geometry=polygon.Polygon, Motion=Vector(0, 0, 10))  # -> Geometry, Transform
rotate = Rotate(Geometry=polygon_2.Polygon, Angle=degrees(Slider(112, range=3..360)), Plane=PlaneXY(0, 0, 0))  # -> Geometry, Transform
rotate_2 = Rotate(Geometry=move.Geometry, Angle=degrees(Slider(101, range=3..360)), Plane=PlaneXY(0, 0, 0))  # -> Geometry, Transform
curve = Curve([<curve referenced from the Rhino model> x2])
region_difference = RegionDifference(CurvesA=rotate.Geometry, CurvesB=rotate_2.Geometry)
loft = Loft(Curves=curve, Options={Adjust=False, Closed=False, LoftEnds=0, LoftSimp=0, LoftType=0, Rebuild=10, Refit=0.01})
xy_plane = XYPlane(Origin=Point(0, 0, 0))
loft_2 = Loft(Options={Adjust=False, Closed=False, LoftEnds=0, LoftSimp=0, LoftType=0, Rebuild=10, Refit=0.01})
cap_holes = CapHoles(Brep=loft)
scale = Scale(Geometry=cap_holes, Center=xy_plane, Factor=Slider(0.937, range=0..1))  # -> Geometry, Transform
cap_holes_2 = CapHoles(Brep=scale.Geometry)
solid_difference = SolidDifference(BrepsA=cap_holes, BrepsB=cap_holes_2)
