# Grasshopper definition nested_cylinders_1.gh (Grasshopper 1.0.7)

number_slider = Slider(3, range=0..10)
cylinder = Cylinder(Base=PlaneXY(0, 0, 0), Radius=Slider(3, range=0..10), Length=Slider(2, range=0..10))
cylinder_2 = Cylinder(Base=PlaneXY(0, 0, 0), Radius=Slider(4, range=0..10), Length=Slider(2, range=0..10))
vector_xyz = VectorXYZ(XComponent=0, YComponent=0, ZComponent=number_slider)  # -> Vector, Length
vector_xyz_2 = VectorXYZ(XComponent=0, YComponent=0, ZComponent=Slider(4, range=0..10))  # -> Vector, Length
extrude = Extrude(Base=cylinder_2, Direction=vector_xyz.Vector)
extrude_2 = Extrude(Base=cylinder, Direction=vector_xyz_2.Vector)
geometry = Geometry(<brep referenced from the Rhino model>)
cap_holes = CapHoles(Brep=extrude)
cap_holes_2 = CapHoles(Brep=extrude_2)
vector_xyz_3 = VectorXYZ(XComponent=0, YComponent=0, ZComponent=number_slider)  # -> Vector, Length
scale = Scale(Geometry=geometry, Center=Point(0, 0, 0), Factor=Slider(0.669, range=0..1))  # -> Geometry, Transform
solid_difference = SolidDifference(BrepsA=cap_holes_2, BrepsB=cap_holes)
solid_intersection = SolidIntersection()
extrude_3 = Extrude(Base=scale.Geometry, Direction=vector_xyz_3.Vector)
cap_holes_3 = CapHoles(Brep=extrude_3)
