# Grasshopper definition nested_cylinders_2.gh (Grasshopper 1.0.7)

geometry = Geometry(<brep referenced from the Rhino model>)
vector_xyz = VectorXYZ(XComponent=0, YComponent=0, ZComponent=Slider(3, range=0..10))  # -> Vector, Length
scale = Scale(Geometry=geometry, Center=Point(0, 0, 0), Factor=Slider(0.63, range=0..1))  # -> Geometry, Transform
# Nested bowls
scale_2 = Scale(Geometry=geometry, Center=Point(0, 0, 0), Factor=Slider(1.401, range=0..10))  # -> Geometry, Transform
extrude = Extrude(Base=scale.Geometry, Direction=vector_xyz.Vector)
cap_holes = CapHoles(Brep=extrude)

cylinder = Cylinder(Base=PlaneXY(0, 0, 0), Radius=Slider(3, range=0..10), Length=Slider(2, range=0..10))
cylinder_2 = Cylinder(Base=PlaneXY(0, 0, 0), Radius=Slider(4, range=0..10), Length=Slider(2, range=0..10))
vector_xyz_2 = VectorXYZ(XComponent=0, YComponent=0, ZComponent=Slider(3, range=0..10))  # -> Vector, Length
vector_xyz_3 = VectorXYZ(XComponent=0, YComponent=0, ZComponent=Slider(4, range=0..10))  # -> Vector, Length
extrude_2 = Extrude(Base=cylinder_2, Direction=vector_xyz_2.Vector)
extrude_3 = Extrude(Base=cylinder, Direction=vector_xyz_3.Vector)
cap_holes_2 = CapHoles(Brep=extrude_2)
cap_holes_3 = CapHoles(Brep=extrude_3)
solid_difference = SolidDifference(BrepsA=cap_holes_3, BrepsB=cap_holes_2)
