# Grasshopper definition voronoi_lamp.gh (Grasshopper 1.0.7)

surface = Surface(<surface referenced from the Rhino model>)
dimensions = Dimensions(Surface=surface)  # -> UDimension, VDimension
plane_surface = PlaneSurface(Plane=PlaneXY(0, 0, 0), XSize=dimensions.UDimension, YSize=dimensions.VDimension)
populate_geometry = PopulateGeometry(Geometry=plane_surface, Count=Slider(50, range=0..50), Seed=Slider(10, range=0..10))
curve = Curve(plane_surface)
voronoi = Voronoi(Points=populate_geometry, Boundary=curve, BruteForceOverride=False)
area = Area(Geometry=voronoi)  # -> Area, Centroid
scale = Scale(Geometry=voronoi, Center=area.Centroid, Factor=Slider(0.938, range=0..1))  # -> Geometry, Transform
curve_2 = Curve(flatten([scale.Geometry, curve]))
vector_xyz = VectorXYZ(XComponent=0, YComponent=0, ZComponent=Slider(0.271, range=0..1))  # -> Vector, Length
boundary_surfaces = BoundarySurfaces(Edges=curve_2)
extrude = Extrude(Base=boundary_surfaces, Direction=vector_xyz.Vector)
brep = Brep(extrude)
