# Grasshopper definition CrystalMaker.gh (Grasshopper 1.0.7)

shaft_radius = Slider(7.1, range=0.5..10)
shaft_count = Slider(8, range=3..20)
cap_count = Slider(31, range=3..200)
cap_radius = Slider(6.1, range=1..100)
randomness = Slider(1, range=0..1)
scale = Slider(1, range=0.1..10)
pt = Point(Point(0, 0, 0))
yz = YZPlane(Origin=pt)
cir = Circle(Plane=yz, Radius=shaft_radius)
sph = Sphere(Base=pt, Radius=cap_radius)
popgeo = PopulateGeometry(Geometry=sph, Count=cap_count, Seed=1)
popgeo_2 = PopulateGeometry(Geometry=cir, Count=shaft_count, Seed=1)
pt2num = PointsToNumbers(Points=flatten([popgeo_2, popgeo]), Mask=4)
lng = ListLength(List=pt2num)
dom = ConstructDomain(DomainStart=expr("-x", randomness), DomainEnd=randomness)
random = Random(Range=dom, Number=lng, Seed=2)
addition = Addition(A=pt2num, B=random)
pt2num_2 = NumbersToPoints(Numbers=addition, Mask=4)
vcell = VoronoiCell(Point=pt, Neighbours=pt2num_2)
scale_nu = ScaleNU(Geometry=vcell, Plane=pt, ScaleX=scale, ScaleY=1, ScaleZ=1)  # -> Geometry, Transform
brep = Brep(scale_nu.Geometry)
