# Grasshopper definition polygon_solid.gh (Grasshopper 1.0.7)

vector_xyz = VectorXYZ(XComponent=0, YComponent=0, ZComponent=Slider(15, range=0..20))  # -> Vector, Length
geometry = Geometry(<curve referenced from the Rhino model>)
geometry_2 = Geometry(<brep referenced from the Rhino model>)
extrude = Extrude(Base=geometry, Direction=vector_xyz.Vector)
cap_holes = CapHoles(Brep=extrude)
